# Dynamo custom node SnoopActiveView.dyf (Dynamo 2.12.1.8246)
# category: RevitLookup
# Allow Snoop Active View In Document Current
# packages: RevitLookupWpf 2022.0.0

init = Custom[Init]()  # package RevitLookupWpf; Init Revitlookup Assembly
fresh = Input(fresh: var[]..[] = false)  # input true to snoop
python_script = Python(IN[0]=init.RevitlookupWpf, IN[1]=fresh)  # IronPython2
# ---------- python_script.python (40 lines) ----------
import clr

clr.AddReference('RevitAPI')
from Autodesk.Revit.DB import *
from Autodesk.Revit.DB.Structure import *

clr.AddReference('RevitAPIUI')
from Autodesk.Revit.UI import *

clr.AddReference('System')
from System.Collections.Generic import List

clr.AddReference('RevitNodes')
import Revit
clr.ImportExtensions(Revit.GeometryConversion)
clr.ImportExtensions(Revit.Elements)

clr.AddReference('RevitServices')
import RevitServices
from RevitServices.Persistence import DocumentManager
from RevitServices.Transactions import TransactionManager

import System 
from System.Collections.Generic import *

import sys
sys.path.append(r'C:\Program Files (x86)\IronPython 2.7\Lib')

doc = DocumentManager.Instance.CurrentDBDocument
uidoc=DocumentManager.Instance.CurrentUIApplication.ActiveUIDocument
uiapp = DocumentManager.Instance.CurrentUIApplication
app = DocumentManager.Instance.CurrentUIApplication.Application

revitlookup = IN[0]
selectElem = doc.ActiveView
flag = IN[1]
if flag:
	OUT = revitlookup.Snoop(selectElem)
else:
	OUT = False
# ----------------------------------------
