# Dynamo custom node SnoopFace.dyf (Dynamo 2.12.1.8246)
# category: RevitLookup
# Allow User Snoop Current Surface In Dynamo
# packages: RevitLookupWpf 2022.0.0

init = Custom[Init]()  # package RevitLookupWpf; Init Revitlookup Assembly
surface = Input(surface: var[]..[])  # surface
python_script = Python(IN[0]=init.RevitlookupWpf, IN[1]=surface)  # IronPython2
# ---------- python_script.python (36 lines) ----------
import clr

clr.AddReference('RevitAPI')
from Autodesk.Revit.DB import *
from Autodesk.Revit.DB.Structure import *

clr.AddReference('RevitAPIUI')
from Autodesk.Revit.UI import *

clr.AddReference('System')
from System.Collections.Generic import List

clr.AddReference('RevitNodes')
import Revit
clr.ImportExtensions(Revit.GeometryConversion)
clr.ImportExtensions(Revit.Elements)

clr.AddReference('RevitServices')
import RevitServices
from RevitServices.Persistence import DocumentManager
from RevitServices.Transactions import TransactionManager

import System 
from System.Collections.Generic import *

import sys
sys.path.append(r'C:\Program Files (x86)\IronPython 2.7\Lib')

doc = DocumentManager.Instance.CurrentDBDocument
uidoc=DocumentManager.Instance.CurrentUIApplication.ActiveUIDocument
uiapp = DocumentManager.Instance.CurrentUIApplication
app = DocumentManager.Instance.CurrentUIApplication.Application

revitlookup = IN[0]
face = IN[1]
OUT = revitlookup.Snoop(face)
# ----------------------------------------
